vi "main.gvi"   [LabVIEW NXG 4.0.0]
panel controls:
  "Stop": bool
  "First": bool
  "Last": bool
  "Next": bool
  "Add": bool
panel indicators:
  "Log": string
types:
  "data.gtype" = cluster{"Logs": string[], "TimeStamps": timestamp[], "index": i32}
diagram:
  w1 = "Init"  # states
  s1 = w1  # shift register
  s2 = "data.gtype" {all zero or empty}  # shift register
  while {
    case (s1) {
      frame "Init", Default {
        w5 = "Idle"  # states
        w2 = default
        w3 = w5
        w4 = s2
      }
      frame "SaveMessage" {
        w2 = default
        w3 = default
        w4 = s2
      }
      frame "ShowMessage" {
        w2 = default
        w3 = default
        w4 = s2
      }
      frame "Stop" {
        w6 = "Stop"  # states
        w2 = FALSE
        w3 = w6
        w4 = s2
      }
      frame "Idle" {
        w7 = 50  # timeout
        event (timeout = w7) {
          on "Timeout" {
            w8 = "Idle"  # states
            w3 = w8
            w4 = s2
          }
          on "Add" Value changed {
            w9 = "Add"  # states
            w3 = w9
            w4 = s2
          }
        }
        w2 = default
      }
      frame "Add" {
        call "dialog.gvi"() -> (log_out=w10, Cancel?=w11, error out=w12)
        Logical Or(w11, w12) -> w13
        case (w13) {
          frame False, Default {
            Property Node(instance in=s2) -> ("Logs"=w14, "TimeStamps"=w15, instance out=w16)
            Get Current Time() -> (current time=w17)
            Build Array(w15, w17) -> w18
            Build Array(w14, w10) -> w19
            Property Node(instance in=w16, "Logs"=w19, "TimeStamps"=w18) -> (instance out=w4)
          }
          frame True {
            # Error
            w4 = s2
          }
        }
        w2 = default
        w3 = "Idle"
      }
    }
    next s1 = w3
    next s2 = w4
    stop if w2
  }
