vi "dialog.gvi"   [LabVIEW NXG 4.0.0]
outputs:
  "log_out": string
  "Cancel?": bool
  "error out": error
panel controls:
  "Log": string
  "Cancel": bool
  "Accept": bool
diagram:
  Property Node(instance in=reference to "Log", "Value"="") -> (error out=w1)
  Property Node(instance in=reference to unnamed native front panel, error in=w1) -> ("Window"=w2, error out=w3)
  Open Window(reference in=w2, error in=w3) -> (reference out=w4, error out=w5)
  s1 = w5  # shift register
  s2 = w4  # shift register
  while {
    Wait(time to wait=50)
    w6 = $Log
    w7 = $Cancel
    Logical Or(w7, $Accept) -> w8
    stop if w8
  }
  Close Window(reference in=s2, error in=s1) -> (error out=w9)
  $"error out" <- w9
  $log_out <- w6
  $"Cancel?" <- w7
